# Grasshopper definition aa_workshop-2.gh (Grasshopper 1.0.7)
# plug-ins: Firefly.X, LunchBox

number_slider = Slider(50, range=0..50)
video_stream = WebCamVideoStream()
number_slider_2 = Slider(42, range=0..100)
python = GhPythonScript(freq=Slider(1, range=0..10), enable=Toggle(False), overwrite=Toggle(True), max_iter=number_slider, reset=Button())  # -> out, TRIGGER, STAMP, DELETE_GUIDS, ITER_ID
# ---------- python: Python ----------
"""
Auto-bake pulse generator (accurate iteration limit + auto reset)
------------------------------------------------
Inputs:
    freq        : Frequency (Hz) — 1 = once per second
    enable      : Enable/disable trigger
    overwrite   : Overwrite previous baked geometry
    max_iter    : Maximum iterations (0 = unlimited)
    reset       : Force reset (True to restart from 0)
    BAKED_GUIDS : connect from LunchBox Bake Object output
Outputs:
    TRIGGER     : Boolean pulse (True when triggered)
    STAMP       : Timestamp string
    DELETE_GUIDS: GUIDs of deleted objects
    ITER_ID     : Current iteration count
"""

import scriptcontext as sc
import Rhino
from System import DateTime

# --- Default values ---
if freq is None or freq <= 0: freq = 1.0
if enable is None: enable = True
if overwrite is None: overwrite = False
if max_iter is None: max_iter = 0
if reset is None: reset = False

TRIGGER = False
DELETE_GUIDS = []

# --- Check if need to reset sticky data ---
prev_enable = sc.sticky.get('auto_bake_prev_enable', False)
first_run = 'auto_bake_iter' not in sc.sticky

if reset or first_run or (enable and not prev_enable):
    sc.sticky['auto_bake_iter'] = 0
    sc.sticky['auto_bake_stop'] = False
    sc.sticky['last_bake_time'] = DateTime.MinValue
    sc.sticky['last_bake_guids'] = []
    STAMP = " Reset triggered"
else:
    STAMP = ""

sc.sticky['auto_bake_prev_enable'] = enable
ITER_ID = sc.sticky.get('auto_bake_iter', 0)
stop_flag = sc.sticky.get('auto_bake_stop', False)

# --- Get GH document ---
doc = ghenv.Component.OnPingDocument()

def safe_reschedule():
    """Schedule re-run safely after current solution ends."""
    if not enable or stop_flag:
        return
    if max_iter > 0 and sc.sticky.get('auto_bake_iter', 0) >= max_iter:
        sc.sticky['auto_bake_stop'] = True
        return
    interval = 1.0 / freq
    def callback(_doc):
        try:
            if not sc.sticky.get('auto_bake_stop', False):
                ghenv.Component.ExpireSolution(False)
        except:
            pass
    doc.ScheduleSolution(int(interval * 1000), callback)

# --- Main logic ---
if not enable:
    STAMP = "⏸ Disabled"
else:
    now = DateTime.Now
    last = sc.sticky.get('last_bake_time', DateTime.MinValue)
    elapsed = (now - last).TotalSeconds
    interval = 1.0 / freq

    current_iter = sc.sticky.get('auto_bake_iter', 0)
    if stop_flag or (max_iter > 0 and current_iter >= max_iter):
        STAMP = "✅ Completed {0} iterations".format(max_iter)
        enable = False
    elif elapsed >= interval:
        current_iter += 1
        sc.sticky['auto_bake_iter'] = current_iter
        ITER_ID = current_iter
        TRIGGER = True
        sc.sticky['last_bake_time'] = now
        STAMP = now.ToString("HH:mm:ss.fff")

        if overwrite:
            last_guids = sc.sticky.get('last_bake_guids', [])
            if last_guids:
                for gid in last_guids:
                    try:
                        Rhino.RhinoDoc.ActiveDoc.Objects.Delete(gid, True)
                    except:
                        pass
                Rhino.RhinoDoc.ActiveDoc.Views.Redraw()
                DELETE_GUIDS = last_guids
    else:
        if not STAMP:
            STAMP = now.ToString("HH:mm:ss.fff")

# --- Save baked GUIDs for next overwrite ---
if 'BAKED_GUIDS' in globals() and BAKED_GUIDS:
    sc.sticky['last_bake_guids'] = BAKED_GUIDS

# --- Schedule next run safely ---
safe_reschedule()
# ---------- end python ----------
panel = Panel(python.STAMP)
resize = ResizeBitmap(BitmapToModify=video_stream, NewResolutionInXAxis=number_slider_2, NewResolutionInYAxis=number_slider_2)
blur = Blur(BitmapToModify=resize, BlurIterations=Slider(2, range=0..10))
Z = UnitZ(Factor=1)
painter = BitmapPainter(BitmapToPaint=resize)
panel_2 = Panel(python.TRIGGER)
eval = Evaluate(F="y/(x+1)", x=number_slider, y=python.ITER_ID)
panel_3 = Panel(eval)
mesh = MeshFromImage(Bmp=painter, Sx=Domain(0, 24), Sy=Domain(0, 18), Z=1, C=True)
contour = Contour(Shape=mesh, Point=Point(0, 0, 0), Direction=Z, Distance=Slider(1.5, range=0..10))
cls = Closed(Curve=contour)  # -> Closed, Periodic
cull = CullPattern(List=contour, CullPattern=cls.Closed)
frgb = ColourRGBF(Alpha=1, Red=panel_3, Green=panel_3, Blue="255")
number_slider_3 = Slider(5, range=0..10)
optical_flow = OpticalFlow(Bmp=video_stream, Sx=Domain(0, 24), Sy=Domain(0, 18), L=12, N=2)  # -> Vectors, VectorMagnitude, VectorFieldLines
optical_flow_2 = OpticalFlow(Bmp=blur, Sx=Domain(0, 24), Sy=Domain(0, 18), L=12, N=2)  # -> Vectors, VectorMagnitude, VectorFieldLines
len = Length(Curve=optical_flow.VectorFieldLines)
bake = ObjectBake(
    BakeToggle=panel_2,
    GeometryObjects=contour,
    Layer=python.STAMP,
    ObjectName=python.STAMP,
    ObjectColor=frgb,
    LayerColor=frgb)
layer = CreateLayers(CreateToggle=panel_2, LayerNames=python.STAMP, LayerColors=frgb)
python_2 = GhPythonScript(freq=Slider(1, range=0..10), enable=Toggle(False), overwrite=Toggle(True), max_iter=number_slider_3, reset=Button())  # -> out, TRIGGER, STAMP, DELETE_GUIDS, ITER_ID
# ---------- python_2: Python ----------
"""
Auto-bake pulse generator (accurate iteration limit + auto reset)
------------------------------------------------
Inputs:
    freq        : Frequency (Hz) — 1 = once per second
    enable      : Enable/disable trigger
    overwrite   : Overwrite previous baked geometry
    max_iter    : Maximum iterations (0 = unlimited)
    reset       : Force reset (True to restart from 0)
    BAKED_GUIDS : connect from LunchBox Bake Object output
Outputs:
    TRIGGER     : Boolean pulse (True when triggered)
    STAMP       : Timestamp string
    DELETE_GUIDS: GUIDs of deleted objects
    ITER_ID     : Current iteration count
"""

import scriptcontext as sc
import Rhino
from System import DateTime

# --- Default values ---
if freq is None or freq <= 0: freq = 1.0
if enable is None: enable = True
if overwrite is None: overwrite = False
if max_iter is None: max_iter = 0
if reset is None: reset = False

TRIGGER = False
DELETE_GUIDS = []

# --- Check if need to reset sticky data ---
prev_enable = sc.sticky.get('auto_bake_prev_enable', False)
first_run = 'auto_bake_iter' not in sc.sticky

if reset or first_run or (enable and not prev_enable):
    sc.sticky['auto_bake_iter'] = 0
    sc.sticky['auto_bake_stop'] = False
    sc.sticky['last_bake_time'] = DateTime.MinValue
    sc.sticky['last_bake_guids'] = []
    STAMP = "🔄 Reset triggered"
else:
    STAMP = ""

sc.sticky['auto_bake_prev_enable'] = enable
ITER_ID = sc.sticky.get('auto_bake_iter', 0)
stop_flag = sc.sticky.get('auto_bake_stop', False)

# --- Get GH document ---
doc = ghenv.Component.OnPingDocument()

def safe_reschedule():
    """Schedule re-run safely after current solution ends."""
    if not enable or stop_flag:
        return
    if max_iter > 0 and sc.sticky.get('auto_bake_iter', 0) >= max_iter:
        sc.sticky['auto_bake_stop'] = True
        return
    interval = 1.0 / freq
    def callback(_doc):
        try:
            if not sc.sticky.get('auto_bake_stop', False):
                ghenv.Component.ExpireSolution(False)
        except:
            pass
    doc.ScheduleSolution(int(interval * 1000), callback)

# --- Main logic ---
if not enable:
    STAMP = "⏸ Disabled"
else:
    now = DateTime.Now
    last = sc.sticky.get('last_bake_time', DateTime.MinValue)
    elapsed = (now - last).TotalSeconds
    interval = 1.0 / freq

    current_iter = sc.sticky.get('auto_bake_iter', 0)
    if stop_flag or (max_iter > 0 and current_iter >= max_iter):
        STAMP = "✅ Completed {0} iterations".format(max_iter)
        enable = False
    elif elapsed >= interval:
        current_iter += 1
        sc.sticky['auto_bake_iter'] = current_iter
        ITER_ID = current_iter
        TRIGGER = True
        sc.sticky['last_bake_time'] = now
        STAMP = now.ToString("HH:mm:ss.fff")

        if overwrite:
            last_guids = sc.sticky.get('last_bake_guids', [])
            if last_guids:
                for gid in last_guids:
                    try:
                        Rhino.RhinoDoc.ActiveDoc.Objects.Delete(gid, True)
                    except:
                        pass
                Rhino.RhinoDoc.ActiveDoc.Views.Redraw()
                DELETE_GUIDS = last_guids
    else:
        if not STAMP:
            STAMP = now.ToString("HH:mm:ss.fff")

# --- Save baked GUIDs for next overwrite ---
if 'BAKED_GUIDS' in globals() and BAKED_GUIDS:
    sc.sticky['last_bake_guids'] = BAKED_GUIDS

# --- Schedule next run safely ---
safe_reschedule()
# ---------- end python_2 ----------
panel_4 = Panel(python_2.STAMP)
panel_5 = Panel(optical_flow_2.VectorFieldLines)
graph = GraphMapper(
    len,
    x0=0,
    x1=1,
    y0=0,
    y1=1,
    container_name="Bezier",
    cpx=[0, 0.06657247245, 0.4289048612, 1],
    cpy=[0.008413851261, 0.1933463812, 0.1817653775, 0.2020315528])
end = EndPoints(Curve=optical_flow.VectorFieldLines)  # -> Start, End
circle = CircleCNR(Center=end.Start, Normal=Vector(0, 0, 1), Radius=graph)
preview = CustomPreview(Geometry=circle, Material=ColourSwatch(SwatchColor=RGB(153, 140, 40)))
panel_6 = Panel(python_2.TRIGGER)
eval_2 = Evaluate(F="y/(x+1)", x=number_slider_3, y=python_2.ITER_ID)
panel_7 = Panel(eval_2)
path = FilePath("C:\Users\willi\OneDrive\Pictures\generated_003.jpg")
frgb_2 = ColourRGBF(Alpha=1, Red=panel_7, Green=panel_7, Blue="255")
load_bitmap = LoadBitmap(FilePathToImageLocation=path)
bake_2 = ObjectBake(
    BakeToggle=panel_6,
    GeometryObjects=optical_flow_2.VectorFieldLines,
    Layer=python_2.STAMP,
    ObjectName=python_2.STAMP,
    ObjectColor=frgb_2,
    LayerColor=frgb_2)
layer_2 = CreateLayers(CreateToggle=panel_6, LayerNames=python_2.STAMP, LayerColors=frgb_2)
number_slider_4 = Slider(20, range=0..100)
number_slider_5 = Slider(52, range=0..100)
number_slider_6 = Slider(0, range=0..100)
number_slider_7 = Slider(67, range=0..100)
Y = UnitY(Factor=1)
optical_flow_3 = OpticalFlow(Bmp=load_bitmap, Sx=number_slider_4, Sy=number_slider_4, L=12, N=2)  # -> Vectors, VectorMagnitude, VectorFieldLines
crv = Curve(optical_flow_3.VectorFieldLines)
Z_2 = UnitZ(Factor=1)
panel_8 = Panel(optical_flow_3.Vectors)
Y_2 = UnitY(Factor=1)
pt = ConstructPoint(XCoordinate=number_slider_6, YCoordinate=number_slider_6, ZCoordinate=number_slider_6)
mesh_2 = MeshFromImage(Bmp=load_bitmap, Sx=number_slider_5, Sy=number_slider_5, Z=1, C=True)
resize_2 = ResizeBitmap(BitmapToModify=load_bitmap, NewResolutionInXAxis=number_slider_7, NewResolutionInYAxis=number_slider_7)
replace = ReplaceColor(
    BitmapToModify=load_bitmap,
    ColorToFind=ColourSwatch(SwatchColor=RGB(255, 255, 255)),
    ColorToReplace=ColourSwatch(SwatchColor=RGB(133, 255, 255)),
    Threshold=Slider(0.47, range=0..1))
edge = EdgeDetection(BitmapToModify=load_bitmap, Threshold=Slider(3, range=0..10), EdgeSelection=2)
pl = PlaneNormal(Origin=pt, ZAxis=Y)
mirror = Mirror(Geometry=mesh_2, Plane=Z_2)  # -> Geometry, Transform
painter_2 = BitmapPainter(BitmapToPaint=resize_2)
painter_3 = BitmapPainter(BitmapToPaint=edge)
painter_4 = BitmapPainter(BitmapToPaint=replace)
rad = Radians(Degrees=Slider(1, range=0..10))
rotate = Rotate(Geometry=mirror.Geometry, Angle=rad, Plane=pl)  # -> Geometry, Transform
demesh = DeconstructMesh(Mesh=rotate.Geometry)  # -> Vertices, Faces, Colours, Normals
Z_3 = UnitZ(Factor=1)
facen = FaceNormals(Mesh=rotate.Geometry)  # -> Centers, Normals
devec = DeconstructVector(Vector=demesh.Normals)  # -> XComponent, YComponent, ZComponent
angle = Angle(VectorA=facen.Normals, VectorB=Z_3)  # -> Angle, Reflex
data = Data(devec.ZComponent)
bnd = Bounds(Numbers=data)
dedomain = DeconstructDomain(Domain=bnd)  # -> Start, End
gradient = Gradient(
    LowerLimit=dedomain.Start,
    UpperLimit=dedomain.End,
    Parameter=data,
    stops=[0: RGB(0, 128, 0), 0.283: RGB(255, 255, 0), 1: RGB(255, 0, 0)])
Z_4 = UnitZ(Factor=1)
contour_2 = Contour(Shape=rotate.Geometry, Point=Point(0, 0, 0), Direction=Z_4, Distance=Slider(0.194, range=0..2))
mcol = MeshColours(Mesh=rotate.Geometry, Colours=gradient)
