# Grasshopper definition aa_workshop-combined-updated.gh (Grasshopper 1.0.7)
# plug-ins: Firefly.X, Kangaroo2 Components, LunchBox

path = FilePath("C:\Users\willi\Downloads\WhatsApp Image 2025-10-28 at 18.17.29_10855136.jpg")
load_bitmap = LoadBitmap(FilePathToImageLocation=path)
pt = ConstructPoint(XCoordinate=Slider(0, range=0..1), YCoordinate=Slider(0.074, range=0..1), ZCoordinate=0)
pt_2 = ConstructPoint(XCoordinate=Slider(0.85, range=0..1), YCoordinate=Slider(0.889, range=0..1), ZCoordinate=0)
region = ImageRegion(BitmapToModify=load_bitmap, MinimumPointOfBoundingArea=pt, MaximumPointOfBoundingArea=pt_2)
number_slider = Slider(100, range=0..100)
painter = BitmapPainter(BitmapToPaint=region)
info = BitmapInfo(FireflyBitmap=painter)  # -> PixelResolutionInXAxis, PixelResolutionInYAxis
division = Division(A=info.PixelResolutionInXAxis, B=number_slider)
division_2 = Division(A=info.PixelResolutionInYAxis, B=division)
mesh = MeshFromImage(Bmp=painter, Sx=number_slider, Sy=division_2, Z=1, C=True)
Z = UnitZ(Factor=1)
number_slider_2 = Slider(0, range=0..100)
mirror = Mirror(Geometry=mesh, Plane=Z)  # -> Geometry, Transform
rad = Radians(Degrees=Slider(1, range=0..10))
Z_2 = UnitZ(Factor=1)
Y = UnitY(Factor=1)
pt_3 = ConstructPoint(XCoordinate=number_slider_2, YCoordinate=number_slider_2, ZCoordinate=number_slider_2)
multiplication = Multiplication(A=Z_2, B=Slider(0, range=0..10))
pl = PlaneNormal(Origin=pt_3, ZAxis=Y)
rotate = Rotate(Geometry=mirror.Geometry, Angle=rad, Plane=pl)  # -> Geometry, Transform
move = Move(Geometry=rotate.Geometry, Motion=multiplication)  # -> Geometry, Transform

# ---- group: SECTIONING
Z_3 = UnitZ(Factor=1)
Z_4 = UnitZ(Factor=1)
multiplication_2 = Multiplication(A=Z_4, B=Slider(-0.12, range=-3..3))
pln = Plane(Z_3)
rotate_2 = Rotate(Geometry=pln, Angle=rad, Plane=pl)  # -> Geometry, Transform
move_2 = Move(Geometry=rotate_2.Geometry, Motion=multiplication_2)  # -> Geometry, Transform

Z_5 = UnitZ(Factor=1)
Z_6 = UnitZ(Factor=1)
multiplication_3 = Multiplication(A=Z_6, B=Slider(-1.3, range=-3..3))
pln_2 = Plane(Z_5)
rotate_3 = Rotate(Geometry=pln_2, Angle=rad, Plane=pl)  # -> Geometry, Transform
move_3 = Move(Geometry=rotate_3.Geometry, Motion=multiplication_3)  # -> Geometry, Transform

Z_7 = UnitZ(Factor=1)
Z_8 = UnitZ(Factor=1)
multiplication_4 = Multiplication(A=Z_8, B=Slider(-1.14, range=-3..3))
pln_3 = Plane(Z_7)
rotate_4 = Rotate(Geometry=pln_3, Angle=rad, Plane=pl)  # -> Geometry, Transform
move_4 = Move(Geometry=rotate_4.Geometry, Motion=multiplication_4)  # -> Geometry, Transform

# ----
sec = MeshPlane(Mesh=move.Geometry, Plane=move_3.Geometry)
sec_2 = MeshPlane(Mesh=move.Geometry, Plane=move_2.Geometry)

# ---- group: medial axis
sec_3 = MeshPlane(Mesh=move.Geometry, Plane=move_4.Geometry)  # -> flatten(Curves)
curvepoint = PointOnCurve(sec_3, parameter=0)
curvepoint_2 = PointOnCurve(sec_3, parameter=1)
ln = Line(StartPoint=curvepoint, EndPoint=curvepoint_2)  # -> flatten(Line)
merge = Merge(Data1=graft(ln), Data2=graft(sec_3))
join = JoinCurves(Curves=merge, Preserve=False)  # -> flatten(Curves)
len = Length(Curve=join)
division_3 = Division(A=len, B=Slider(1.06, range=0..10))
graft = GraftTree(Tree=join, IncludeEmptyLists=True, IncludeNullItems=True)  # -> simplify(Tree)
divide = DivideCurve(Curve=join, Count=division_3, Kinks=False)  # -> Points, Tangents, Parameters
voronoi = Voronoi(Points=divide.Points, BruteForceOverride=False)  # -> simplify(Cells)
explode = Explode(Curve=voronoi, Recursive=True)  # -> Segments, Vertices
path_mapper = PathMapper(explode.Segments, source="{a;b}", target="{a}")
dupln = RemoveDuplicateLines(Lines=path_mapper, Tolerance=0.01)  # -> simplify(UniqueLines)
curvepoint_3 = PointOnCurve(dupln, parameter=0)
curvepoint_4 = PointOnCurve(dupln, parameter=1)
incurve = PointInCurve(Point=curvepoint_3, Curve=graft)  # -> Relationship, Point
incurve_2 = PointInCurve(Point=curvepoint_4, Curve=graft)  # -> Relationship, Point
and = GateAnd(A=incurve.Relationship, B=incurve_2.Relationship)
Z_9 = UnitZ(Factor=1)
cull = CullPattern(List=dupln, CullPattern=and)
multiplication_5 = Multiplication(A=Slider(0, range=-1..1), B=number_slider)
multiplication_6 = Multiplication(A=multiplication_5, B=Z_9)
move_5 = Move(Geometry=cull, Motion=multiplication_6)  # -> Geometry, Transform

# ---- group: slope
demesh = DeconstructMesh(Mesh=move.Geometry)  # -> Vertices, Faces, Colours, Normals
Z_10 = UnitZ(Factor=1)
facen = FaceNormals(Mesh=move.Geometry)  # -> Centers, Normals
devec = DeconstructVector(Vector=demesh.Normals)  # -> XComponent, YComponent, ZComponent
angle = Angle(VectorA=facen.Normals, VectorB=Z_10)  # -> Angle, Reflex
data = Data(devec.ZComponent)
bnd = Bounds(Numbers=data)
dedomain = DeconstructDomain(Domain=bnd)  # -> Start, End
gradient = Gradient(
    LowerLimit=dedomain.Start,
    UpperLimit=dedomain.End,
    Parameter=data,
    stops=[0: RGB(0, 128, 0), 0.283: RGB(255, 255, 0), 1: RGB(255, 0, 0)])
Z_11 = UnitZ(Factor=1)
multiplication_7 = Multiplication(A=Z_11, B=number_slider)
mcol = MeshColours(Mesh=move.Geometry, Colours=gradient)
multiplication_8 = Multiplication(A=multiplication_7, B=Slider(0.5, range=0..1))
move_6 = Move(Geometry=mcol, Motion=multiplication_8)  # -> Geometry, Transform

# ---- group: SELECTS ISLANDS
cls = Closed(Curve=sec)  # -> Closed, Periodic
cull_2 = CullPattern(List=sec, CullPattern=cls.Closed)
area = Area(Geometry=cull_2)  # -> Area, Centroid
bnd_2 = Bounds(Numbers=area.Area)
dedomain_2 = DeconstructDomain(Domain=bnd_2)  # -> Start, End
subtraction = Subtraction(A=dedomain_2.Start, B=dedomain_2.End)
multiplication_9 = Multiplication(A=subtraction, B=Slider(0.93, range=0..1))
addition = Addition(A=dedomain_2.End, B=multiplication_9)
larger = LargerThan(FirstNumber=area.Area, SecondNumber=addition)  # -> LargerThan, OrEqualTo
cull_3 = CullPattern(List=cull_2, CullPattern=larger.LargerThan)
area_2 = Area(Geometry=cull_3)  # -> Area, Centroid

cls_2 = Closed(Curve=sec_2)  # -> Closed, Periodic
cull_4 = CullPattern(List=sec_2, CullPattern=cls_2.Closed)
area_3 = Area(Geometry=cull_4)  # -> Area, Centroid
bnd_3 = Bounds(Numbers=area_3.Area)
dedomain_3 = DeconstructDomain(Domain=bnd_3)  # -> Start, End
subtraction_2 = Subtraction(A=dedomain_3.Start, B=dedomain_3.End)
multiplication_10 = Multiplication(A=subtraction_2, B=Slider(0.93, range=0..1))
addition_2 = Addition(A=dedomain_3.End, B=multiplication_10)
larger_2 = LargerThan(FirstNumber=area_3.Area, SecondNumber=addition_2)  # -> LargerThan, OrEqualTo
cull_5 = CullPattern(List=cull_4, CullPattern=larger_2.LargerThan)
area_4 = Area(Geometry=cull_5)  # -> Area, Centroid

# ----
Z_12 = UnitZ(Factor=1)
contour = Contour(Shape=move.Geometry, Point=Point(0, 0, 0), Direction=Z_12, Distance=Slider(0.15, range=0..1))
flatten = FlattenTree(Tree=contour, Path="{0}")
cls_3 = Closed(Curve=flatten)  # -> Closed, Periodic
not = GateNot(A=cls_3.Closed)
cull_6 = CullPattern(List=flatten, CullPattern=not)
cull_7 = CullPattern(List=flatten, CullPattern=cls_3.Closed)
area_5 = Area(Geometry=cull_7)  # -> Area, Centroid
bnd_4 = Bounds(Numbers=area_5.Area)
dedomain_4 = DeconstructDomain(Domain=bnd_4)  # -> Start, End
subtraction_3 = Subtraction(A=dedomain_4.End, B=dedomain_4.Start)
multiplication_11 = Multiplication(A=subtraction_3, B=Slider(0.01, range=0..1))
larger_3 = LargerThan(FirstNumber=area_5.Area, SecondNumber=multiplication_11)  # -> LargerThan, OrEqualTo
cull_8 = CullPattern(List=cull_7, CullPattern=larger_3.LargerThan)
merge_2 = Merge(Data1=cull_6, Data2=cull_8)
smoothpline = SmoothPolyline(Polyline=merge_2, Strength=1, Times=1)
crv = Curve(smoothpline)
curvepoint_5 = PointOnCurve(crv, parameter=0.5)
pdecon = Deconstruct(Point=curvepoint_5)  # -> XComponent, YComponent, ZComponent
bnd_5 = Bounds(Numbers=pdecon.ZComponent)
dedomain_5 = DeconstructDomain(Domain=bnd_5)  # -> Start, End
gradient_2 = Gradient(
    LowerLimit=dedomain_5.Start,
    UpperLimit=dedomain_5.End,
    Parameter=pdecon.ZComponent,
    stops=[0: RGB(165, 255, 255), 1: RGB(115, 26, 0)])
panel = Panel(gradient_2)
preview = CustomPreview(Geometry=crv, Material=gradient_2)

# ---- group: ANNOTATES
Z_13 = UnitZ(Factor=1)
multiplication_12 = Multiplication(A=Slider(0.22, range=0..1), B=number_slider)
multiplication_13 = Multiplication(A=multiplication_12, B=Z_13)
move_7 = Move(Geometry=area_4.Centroid, Motion=multiplication_13)  # -> Geometry, Transform
line = LineSDL(Start=area_4.Centroid, Direction=Z_13, Length=multiplication_12)
tag = TextTag3D(Location=move_7.Geometry, Text=area_4.Area, Size=1, Justification=7)

Z_14 = UnitZ(Factor=1)
multiplication_14 = Multiplication(A=Slider(-0.22, range=-1..1), B=number_slider)
multiplication_15 = Multiplication(A=multiplication_14, B=Z_14)
move_8 = Move(Geometry=area_2.Centroid, Motion=multiplication_15)  # -> Geometry, Transform
line_2 = LineSDL(Start=area_2.Centroid, Direction=Z_14, Length=multiplication_14)
tag_2 = TextTag3D(Location=move_8.Geometry, Text=area_2.Area, Size=1, Justification=7)

# ----
number_slider_3 = Slider(5, range=0..10)
python = GhPythonScript(enable=Toggle(False), overwrite=Toggle(True), freq=Slider(1, range=0..10), max_iter=number_slider_3)  # -> out, TRIGGER, STAMP, DELETE_GUIDS, ITER_ID
# ---------- python: Python ----------
"""
Auto-bake pulse generator (auto reset, no reset input)
------------------------------------------------------
Inputs:
    freq        : Frequency (Hz) — 1 = once per second
    enable      : Enable/disable trigger (auto reset when False→True)
    overwrite   : Overwrite previous baked geometry
    max_iter    : Maximum iterations (0 = unlimited)
Outputs:
    TRIGGER     : Boolean pulse (True when triggered)
    STAMP       : Timestamp string
    DELETE_GUIDS: GUIDs of deleted objects
    ITER_ID     : Current iteration count
"""

import scriptcontext as sc
import Rhino
from System import DateTime

# --- Default values ---
if freq is None or freq <= 0: freq = 1.0
if enable is None: enable = True
if overwrite is None: overwrite = False
if max_iter is None: max_iter = 0

TRIGGER = False
DELETE_GUIDS = []

# --- Detect enable state change (auto reset on False→True) ---
prev_enable = sc.sticky.get('auto_bake_prev_enable', False)
first_run = 'auto_bake_iter' not in sc.sticky

if first_run or (enable and not prev_enable):
    sc.sticky['auto_bake_iter'] = 0
    sc.sticky['auto_bake_stop'] = False
    sc.sticky['last_bake_time'] = DateTime.MinValue
    sc.sticky['last_bake_guids'] = []
    STAMP = "🔄 Auto-reset triggered"
else:
    STAMP = ""

sc.sticky['auto_bake_prev_enable'] = enable
ITER_ID = sc.sticky.get('auto_bake_iter', 0)
stop_flag = sc.sticky.get('auto_bake_stop', False)

# --- Get current GH document ---
doc = ghenv.Component.OnPingDocument()

def safe_reschedule():
    """Schedule re-run safely after current solution ends."""
    if not enable or stop_flag:
        return
    if max_iter > 0 and sc.sticky.get('auto_bake_iter', 0) >= max_iter:
        sc.sticky['auto_bake_stop'] = True
        return
    interval = 1.0 / freq
    def callback(_doc):
        try:
            if not sc.sticky.get('auto_bake_stop', False):
                ghenv.Component.ExpireSolution(False)
        except:
            pass
    doc.ScheduleSolution(int(interval * 1000), callback)

# --- Main logic ---
if not enable:
    STAMP = "⏸ Disabled"
else:
    now = DateTime.Now
    last = sc.sticky.get('last_bake_time', DateTime.MinValue)
    elapsed = (now - last).TotalSeconds
    interval = 1.0 / freq

    current_iter = sc.sticky.get('auto_bake_iter', 0)
    if stop_flag or (max_iter > 0 and current_iter >= max_iter):
        STAMP = "✅ Completed {0} iterations".format(max_iter)
        enable = False
    elif elapsed >= interval:
        # --- Increment iteration ---
        current_iter += 1
        sc.sticky['auto_bake_iter'] = current_iter
        ITER_ID = current_iter
        TRIGGER = True
        sc.sticky['last_bake_time'] = now
        STAMP = now.ToString("HH:mm:ss.fff")

        # --- Delete previous baked objects ---
        if overwrite:
            last_guids = sc.sticky.get('last_bake_guids', [])
            if last_guids:
                for gid in last_guids:
                    try:
                        Rhino.RhinoDoc.ActiveDoc.Objects.Delete(gid, True)
                    except:
                        pass
                Rhino.RhinoDoc.ActiveDoc.Views.Redraw()
                DELETE_GUIDS = last_guids
    else:
        if not STAMP:
            STAMP = now.ToString("HH:mm:ss.fff")

# --- Save baked GUIDs for next overwrite ---
if 'BAKED_GUIDS' in globals() and BAKED_GUIDS:
    sc.sticky['last_bake_guids'] = BAKED_GUIDS

# --- Schedule next run safely ---
safe_reschedule()
# ---------- end python ----------
panel_2 = Panel(python.STAMP)
panel_3 = Panel(python.TRIGGER)
eval = Evaluate(F="y/(x+1)", x=number_slider_3, y=python.ITER_ID)
panel_4 = Panel(eval)
python_2 = GhPythonScript(STEP=Slider(10, range=0..100), ITER_ID=python.ITER_ID)  # -> out, Z_MOVE
# ---------- python_2: Python ----------
"""
Step Controller
---------------
Inputs:
    ITER_ID : Current iteration count (integer)
    STEP    : Z offset per iteration (number)
Outputs:
    Z_MOVE  : Translation vector for Move component
"""

import Rhino.Geometry as rg

if ITER_ID is None:
    ITER_ID = 0
if STEP is None:
    STEP = 0.0

# 计算当前迭代的 Z 偏移量
z_offset = float(ITER_ID) * float(STEP)

# 生成位移向量
Z_MOVE = rg.Vector3d(0, 0, z_offset)
# ---------- end python_2 ----------
frgb = ColourRGBF(Alpha=1, Red=panel_4, Green=panel_4, Blue="255")
Z_15 = UnitZ(Factor=python_2.Z_MOVE)
move_9 = Move(Geometry=crv, Motion=Z_15)  # -> Geometry, Transform
bake = ObjectBake(
    BakeToggle=panel_3,
    GeometryObjects=move_9.Geometry,
    Layer=python.STAMP,
    ObjectName=python.STAMP,
    ObjectColor=frgb,
    LayerColor=frgb)
layer = CreateLayers(CreateToggle=panel_3, LayerNames=python.STAMP, LayerColors=frgb)
